# Grasshopper definition Origamaker.gh (Grasshopper 1.0.7)
# plug-ins: Anemone

pt = Point(<point referenced from the Rhino model>)

top_line = Curve(<curve referenced from the Rhino model>)
vertical_line = Curve(<curve referenced from the Rhino model>)

cluster = Cluster_3(top_lines=top_line, danmen=vertical_line)  # -> mesh, simplify(flatten(vertical_lines)), horizontal_lines, n_of_horizontal_layers, n_of_vertical_layers, initial_d, surfaces
branch = TreeBranch(Tree=cluster.surfaces, Path="{0;1}", MaintainPaths=True)
item = ListItem(List=cluster.surfaces, Index=0, Wrap=True)
item_2 = ListItem(List=cluster.surfaces, Index="1", Wrap=True)
explode = Explode(Curve=item, Recursive=True)  # -> simplify(Segments), Vertices
explode_2 = Explode(Curve=item_2, Recursive=True)  # -> Segments, Vertices
item_3 = ListItem(List=explode.Vertices, Index=0, Wrap=True)  # -> simplify(Item)
item_4 = ListItem(List=explode_2.Vertices, Index=0, Wrap=True)  # -> simplify(Item)
pl = PlaneNormal(Origin=item_4, ZAxis=item_2)
panel = Panel(pl)
xy = XYPlane(Origin=item_4)
srf = Surface(pl)
cp = PlaneClosestPoint(Point=item_3, Plane=pl)  # -> Point, UVPoint, Distance
cp_2 = PlaneClosestPoint(Point=item_3, Plane=xy)  # -> Point, UVPoint, Distance
branch_2 = TreeBranch(Tree=srf, Path="{0;0}", MaintainPaths=True)
panel_3 = Panel(cp.Distance)
explode_3 = Explode(Curve=cluster.horizontal_lines, Recursive=True)  # -> simplify(Segments), Vertices
abs = Absolute(Value=cp_2.Distance)
panel_4 = Panel(cp_2.Distance)
vec = VectorXYZ(XComponent=cp.Distance, YComponent=abs, ZComponent=0)  # -> Vector, Length
subtraction = Subtraction(A=cluster.n_of_vertical_layers, B="1")
path_mapper = PathMapper(vec.Vector, source="{A;B}", target="{B}(A)")
panel_5 = Panel(path_mapper)
len = Length(Curve=explode_3.Segments)
fastloopstart = FastLoopStart(Iterations=subtraction)  # -> port, Counter, Data
panel_6 = Panel(cluster.n_of_horizontal_layers)
item_5 = ListItem(List=path_mapper, Index=fastloopstart.Counter, Wrap=True)
addition = Addition(A=fastloopstart.Data, B=item_5)
panel_7 = Panel(item_5)
path_mapper_2 = PathMapper(len, source="{A}(i)", target="{i}(A)")
fastloopend = FastLoopEnd(port=fastloopstart.port, Exit=False, Data=addition, RecordData=True, TimeOutVal=0)
panel_8 = Panel(path_mapper_2)
panel_9 = Panel("{0}")
panel_10 = Panel(fastloopend)
path_mapper_3 = PathMapper(fastloopend, source="{A;B}", target="{B}(A)")
vec_2 = VectorXYZ(XComponent=0, YComponent=0, ZComponent=0)  # -> Vector, Length
repeat = RepeatData(Data=vec_2.Vector, Length=cluster.n_of_horizontal_layers)  # -> simplify(graft(Data))
X = UnitX(Factor="150")
item_6 = ListItem(List=path_mapper_2, Index=0, Wrap=True)  # -> flatten(Item)
arrlinear = LinearArray(Geometry=pt, Direction=X, Count=panel_6)  # -> simplify(graft(Geometry)), Transform
merge = Merge(Data1=repeat, Data2=path_mapper_3)
data = Data(simplify(merge))
panel_11 = Panel(data)
devec = DeconstructVector(Vector=merge)  # -> XComponent, YComponent, ZComponent
panel_12 = Panel(devec.XComponent)
sort = SortList(Keys=devec.XComponent)  # -> Keys, ValuesA
panel_13 = Panel(sort.Keys)
item_7 = ListItem(List=panel_13, Index=0, Wrap=True)
panel_14 = Panel(item_7)
multiplication = Multiplication(A=panel_14, B="-2")
panel_15 = Panel(multiplication)
equals = Equality(FirstNumber=panel_14, SecondNumber=panel_13)  # -> Equality, Inequality
data_2 = Data(flatten(multiplication))
shift = ShiftList(List=item_6, Shift="-1", Wrap=True)
panel_16 = Panel(shift)
dispatch = Dispatch(List=path_mapper_2, DispatchPattern=equals.Equality)  # -> ListA, ListB
X_2 = UnitX(Factor=1)
panel_17 = Panel(equals.Equality)
panel_18 = Panel(arrlinear.Geometry)
panel_19 = Panel(dispatch.ListA)
addition_2 = Addition(A=shift, B=data_2)
lng = ListLength(List=addition_2)
subtraction_2 = Subtraction(A=lng, B="1")
dom = ConstructDomain(DomainStart="1", DomainEnd=subtraction_2)
subset = SubList(List=addition_2, Domain=dom, Wrap=True)  # -> List, Index
panel_20 = Panel(addition_2)
panel_21 = Panel(subset.List)
subtraction_3 = Subtraction(A=cluster.n_of_horizontal_layers, B="2")
fastloopstart_2 = FastLoopStart(Iterations=subtraction_3, Data=pt)  # -> port, Counter, Data
item_8 = ListItem(List=panel_21, Index=fastloopstart_2.Counter, Wrap=True)
# d/sin(a) (二等分線方向の並行移動の大きさ）
X_3 = UnitX(Factor=item_8)
move = Move(Geometry=fastloopstart_2.Data, Motion=X_3)  # -> Geometry, Transform
fastloopend_2 = FastLoopEnd(port=fastloopstart_2.port, Exit=False, Data=move.Geometry, RecordData=True, TimeOutVal=0)  # -> flatten(Data)
merge_2 = Merge(Data1=pt, Data2=fastloopend_2)  # -> graft(Result)
line = LineSDL(Start=merge_2, Direction=X_2, Length=path_mapper_2)  # -> simplify(graft(Line))
panel_22 = Panel(line)
data_3 = Data(fastloopend_2)
panel_23 = Panel(merge_2)
data_4 = Data(graft(merge))
move_2 = Move(Geometry=line, Motion=data_4)  # -> simplify(Geometry), Transform
panel_24 = Panel(move_2.Geometry)
panel_25 = Panel(data_4)
path_mapper_4 = PathMapper(move_2.Geometry, source="{A;B}", target="{A}(B)")
explode_4 = Explode(Curve=path_mapper_4, Recursive=True)  # -> Segments, Vertices
panel_26 = Panel(explode_4.Vertices)
path_mapper_5 = PathMapper(move_2.Geometry, source="{A;B}", target="{B}(A)")
panel_27 = Panel(path_mapper_4)
shift_2 = ShiftList(List=path_mapper_5, Shift=1, Wrap=True)
tstat = TreeStatistics(Tree=path_mapper_4)  # -> Paths, Length, Count
item_9 = ListItem(List=tstat.Paths, Index="-1", Wrap=True)
item_10 = ListItem(List=panel_26, Index=0, Wrap=True)
item_11 = ListItem(List=panel_26, Index="1", Wrap=True)
branch_3 = TreeBranch(Tree=path_mapper_5, Path="{0}", MaintainPaths=True)
explode_5 = Explode(Curve=shift_2, Recursive=True)  # -> Segments, Vertices
branch_4 = TreeBranch(Tree=path_mapper_4, Path="{0}", MaintainPaths=True)
path_mapper_6 = PathMapper(item_11, source="{A;B}", target="{A}(B)")
branch_5 = TreeBranch(Tree=path_mapper_4, Path=item_9, MaintainPaths=True)
path_mapper_7 = PathMapper(item_10, source="{A;B}", target="{A}(B)")
tstat_2 = TreeStatistics(Tree=path_mapper_5)  # -> Paths, Length, Count
tstat_3 = TreeStatistics(Tree=path_mapper_5)  # -> Paths, Length, Count
lng_2 = ListLength(List=tstat_2.Length)
explode_6 = Explode(Curve=branch_4, Recursive=True)  # -> Segments, Vertices
panel_28 = Panel(explode_5.Vertices)
explode_7 = Explode(Curve=branch_5, Recursive=True)  # -> Segments, Vertices
shift_3 = ShiftList(List=path_mapper_6, Shift=1, Wrap=True)
shift_4 = ShiftList(List=path_mapper_7, Shift=1, Wrap=True)
subtraction_4 = Subtraction(A=lng_2, B="2")
item_12 = ListItem(List=tstat_3.Paths, Index="-1", Wrap=True)
explode_8 = Explode(Curve=branch_3, Recursive=True)  # -> Segments, Vertices
ln = Line(StartPoint=path_mapper_6, EndPoint=shift_3)
ln_2 = Line(StartPoint=path_mapper_7, EndPoint=shift_4)
item_13 = ListItem(List=explode_6.Vertices, Index=0, Wrap=True)
item_14 = ListItem(List=explode_7.Vertices, Index="1", Wrap=True)
dom_2 = ConstructDomain(DomainStart="1", DomainEnd=subtraction_4)
item_15 = ListItem(List=explode_5.Vertices, Index=0, Wrap=True)  # -> simplify(Item)
branch_6 = TreeBranch(Tree=path_mapper_5, Path=item_12, MaintainPaths=True)
subset_2 = SubList(List=tstat_2.Paths, Domain=dom_2, Wrap=True)  # -> List, Index
panel_29 = Panel(item_15)
item_16 = ListItem(List=explode_5.Vertices, Index="1", Wrap=True)  # -> simplify(Item)
panel_30 = Panel(explode_8.Vertices)
lng_3 = ListLength(List=ln_2)
ln_3 = Line(StartPoint=item_13, EndPoint=item_14)
lng_4 = ListLength(List=ln)
path_mapper_8 = PathMapper(item_16, source="{A;B}", target="{A}(B)")
path_mapper_9 = PathMapper(item_15, source="{A;B}", target="{A}(B)")
branch_7 = TreeBranch(Tree=path_mapper_5, Path=subset_2.List, MaintainPaths=True)
subtraction_5 = Subtraction(A=lng_3, B="2")
subtraction_6 = Subtraction(A=lng_4, B="2")
explode_9 = Explode(Curve=branch_6, Recursive=True)  # -> Segments, Vertices
subset_3 = SubList(List=ln_2, Domain=subtraction_5, Wrap=True)  # -> List, Index
subset_4 = SubList(List=ln, Domain=subtraction_6, Wrap=True)  # -> List, Index
shift_5 = ShiftList(List=path_mapper_8, Shift="-1", Wrap=True)
item_17 = ListItem(List=explode_8.Vertices, Index=0, Wrap=True)  # -> flatten(Item)
item_18 = ListItem(List=explode_8.Vertices, Index="1", Wrap=True)  # -> flatten(Item)
panel_31 = Panel(subset_3.List)
ln_4 = Line(StartPoint=path_mapper_9, EndPoint=shift_5)  # -> simplify(Line)
panel_32 = Panel(explode_9.Vertices)
shift_6 = ShiftList(List=item_17, Shift=1, Wrap=True)
addition_3 = Addition(A=shift_6, B=item_18)
panel_33 = Panel(ln_4)
split = SplitList(List=subset_3.List, Index="1")  # -> ListA, ListB
split_2 = SplitList(List=subset_4.List, Index="1")  # -> ListA, ListB
item_19 = ListItem(List=explode_9.Vertices, Index=0, Wrap=True)  # -> flatten(Item)
item_20 = ListItem(List=explode_9.Vertices, Index="1", Wrap=True)  # -> flatten(Item)
lng_5 = ListLength(List=ln_4)
tstat_4 = TreeStatistics(Tree=subset_3.List)  # -> Paths, Length, Count
shift_7 = ShiftList(List=item_19, Shift=1, Wrap=True)
subtraction_7 = Subtraction(A=lng_5, B="2")
tstat_5 = TreeStatistics(Tree=subset_3.List)  # -> Paths, Length, Count
addition_4 = Addition(A=shift_7, B=item_20)
item_21 = ListItem(List=tstat_4.Paths, Index="0", Wrap=True)
subset_5 = SubList(List=ln_4, Domain=subtraction_7, Wrap=True)  # -> simplify(List), Index
panel_34 = Panel(subset_5.List)
item_22 = ListItem(List=tstat_5.Paths, Index="-1", Wrap=True)
split_3 = SplitTree(Data=subset_3.List, Masks=flatten(item_21))  # -> Positive, Negative
division = Division(A=addition_3, B="2")
split_4 = SplitTree(Data=subset_4.List, Masks=flatten(item_22))  # -> Positive, Negative
division_2 = Division(A=addition_4, B="2")
tstat_6 = TreeStatistics(Tree=subset_5.List)  # -> Paths, Length, Count
lng_6 = ListLength(List=tstat_6.Paths)
ln_5 = Line(StartPoint=division, EndPoint=division_2)
lng_7 = ListLength(List=ln_5)
subtraction_8 = Subtraction(A=lng_6, B="2")
dom_3 = ConstructDomain(DomainStart="1", DomainEnd=subtraction_8)
subtraction_9 = Subtraction(A=lng_7, B="2")
subset_6 = SubList(List=tstat_6.Paths, Domain=dom_3, Wrap=True)  # -> List, Index
item_23 = ListItem(List=tstat_6.Paths, Index="-1", Wrap=True)
subset_7 = SubList(List=ln_5, Domain=subtraction_9, Wrap=True)  # -> List, Index
branch_8 = TreeBranch(Tree=subset_5.List, Path=item_23, MaintainPaths=True)
branch_9 = TreeBranch(Tree=subset_5.List, Path="{0}", MaintainPaths=True)
branch_10 = TreeBranch(Tree=subset_5.List, Path=subset_6.List, MaintainPaths=True)
merge_3 = Merge(Data1=subset_3.List, Data2=subset_4.List, Data3=ln_3, Data4=subset_7.List)

merge_4 = Merge(
    Data1=split_3.Positive,
    Data2=split_4.Positive,
    Data3=branch_3,
    Data4=branch_6,
    Data5=branch_10,
    Data6=branch_8,
    Data7=branch_9)  # -> flatten(Result)
merge_5 = Merge(Data1=subset_7.List, Data2=split_3.Negative, Data3=split_4.Negative, Data4=branch_7)  # -> flatten(Result)

# ==== cluster Cluster_3
danmen = ClusterInput()
top_lines = ClusterInput()
top_lines_2 = Curve(top_lines)
danmen_2 = Curve(danmen)
explode = Explode(Curve=danmen_2, Recursive=True)  # -> Segments, Vertices
explode_2 = Explode(Curve=top_lines_2, Recursive=True)  # -> Segments, Vertices

# ----
# 縦インプットをベクトルに変換
panel = Panel("0")
subset = SubList(List=explode.Vertices, Domain=panel, Wrap=True)  # -> List, Index
vec2pt = Vector2Pt(PointA=subset.List, PointB=explode.Vertices, Unitize=False)  # -> Vector, Length
lng = ListLength(List=vec2pt.Vector)
subtraction = Subtraction(A=lng, B="1")
dom = ConstructDomain(DomainStart="1", DomainEnd=subtraction)
subset_2 = SubList(List=vec2pt.Vector, Domain=dom, Wrap=True)  # -> List, Index

lng_2 = ListLength(List=explode_2.Segments)
lng_3 = ListLength(List=explode.Segments)
n_of_vertical_layers = ClusterOutput(lng_3)
n_of_horizontal_layers = ClusterOutput(lng_2)

# ----
# オフセット＋平行移動
devec = DeconstructVector(Vector=subset_2.List)  # -> XComponent, YComponent, ZComponent
offset = OffsetCurve(Curve=top_lines_2, Distance=devec.XComponent, Plane=PlaneXY(0, 0, 0), Corners=1)  # -> flatten(Curve)
Z = UnitZ(Factor=devec.YComponent)

polylineoffset = PolylineOffset(
    Polyline=top_lines_2,
    Distance=graft(devec.XComponent),
    AbsoluteTolerance=0,
    AngleTolerance=0,
    KeepDuplicates=False,
    AvoidSelfIntersections=False)  # -> flatten(OffsettedPolyline), OffsettedPolylineReverse

move = Move(Geometry=polylineoffset.OffsettedPolyline, Motion=Z)  # -> flatten(Geometry), Transform

merge = Merge(Data1=top_lines_2, Data2=move.Geometry)
# Horizontal lines からメッシュ生成
origamifromhorizontallines = OrigamiFromHorizontalLines(data=merge, A=lng_3, nofh=lng_2)  # -> R, L, surfaces
item = ListItem(List=devec.XComponent, Index="0", Wrap=True)
surfaces = ClusterOutput(origamifromhorizontallines.surfaces)
initial_d = ClusterOutput(item)
vertical_lines = ClusterOutput(origamifromhorizontallines.L)
horizontal_lines = ClusterOutput(merge)
mesh = ClusterOutput(origamifromhorizontallines.R)

# ==== cluster OrigamiFromHorizontalLines
A = ClusterInput()
nofh = ClusterInput()
data = ClusterInput()

data_2 = Data(data)
addition = Addition(A=nofh, B="1")
multiplication = Multiplication(A=A, B=addition)
subtraction = Subtraction(A=multiplication, B="1")
dom = ConstructDomain(DomainStart="0", DomainEnd=subtraction)
panel = Panel(addition)
panel_2 = Panel(dom)
explode = Explode(Curve=data_2, Recursive=True)  # -> Segments, flatten(Vertices)
shift = ShiftList(List=explode.Vertices, Shift=panel, Wrap=True)
ln = Line(StartPoint=explode.Vertices, EndPoint=shift)
subset = SubList(List=ln, Domain=panel_2, Wrap=True)  # -> List, Index
merge = Merge(Data1=explode.Segments, Data2=subset.List)  # -> flatten(Result)
wbweave = WeaverbirdsMeshFromLinesWeaveBack(Lines=merge, MaximumValence=4)  # disabled

cluster = Cluster_2(L=simplify(explode.Segments), relay=subset.List, A=nofh)  # -> M, edges
surfaces = ClusterOutput(cluster.edges)
L = ClusterOutput(subset.List)
R = ClusterOutput(cluster.M)

# ==== cluster Cluster_2
L = ClusterInput()
relay = ClusterInput()
A = ClusterInput()
shift = ShiftList(List=flatten(L), Shift=A, Wrap=True)  # -> flatten(List)
addition = Addition(A=A, B="1")
lng = ListLength(List=shift)
subtraction = Subtraction(A=lng, B=A)
partition = PartitionList(List=relay, Size=addition)  # -> simplify(Chunks)
shift_2 = ShiftList(List=partition, Shift=1, Wrap=True)  # -> simplify(List)
subtraction_2 = Subtraction(A=subtraction, B="1")
subset = SubList(List=flatten(shift), Domain=subtraction_2, Wrap=True)  # -> List, Index
subset_2 = SubList(List=flatten(L), Domain=subtraction_2, Wrap=True)  # -> List, Index
cluster = Cluster(L=partition)  # -> simplify(graft(L_2))
cluster_2 = Cluster(L=shift_2)  # -> simplify(graft(L_2))
merge = Merge(Data1=cluster, Data2=cluster_2)
data = Data(subset_2.List)
partition_2 = PartitionList(List=subset.List, Size=A)  # -> simplify(graft(Chunks))
partition_3 = PartitionList(List=subset_2.List, Size=A)  # -> simplify(graft(Chunks))
merge_2 = Merge(Data1=partition_2, Data2=partition_3)
merge_3 = Merge(Data1=merge_2, Data2=merge)
item = ListItem(List=merge_3, Index=0, Wrap=True)
item_2 = ListItem(List=merge_3, Index="2", Wrap=True)
item_3 = ListItem(List=merge_3, Index="1", Wrap=True)
item_4 = ListItem(List=merge_3, Index="3", Wrap=True)
edgesrf = EdgeSurface(CurveA=item, CurveB=item_3, CurveC=item_2, CurveD=item_4)
mesh = MeshBrep(
    Brep=edgesrf,
    Settings={GridMaxCount=0, GridMinCount=16, JaggedSeams=False, MaxEdgeLength=0, MinEdgeLength=0.0001, MinTolerance=0, Refine=True, RefineAngle=0, RelativeTolerance=0.65, SimplePlanes=True, Tolerance=0})
edges = ClusterOutput(merge_3)
M = ClusterOutput(mesh)

# ==== cluster Cluster
L = ClusterInput()
lng = ListLength(List=L)
subtraction = Subtraction(A=lng, B="2")
subset = SubList(List=L, Domain=subtraction, Wrap=True)  # -> List, Index
L_2 = ClusterOutput(subset.List)
