# Grasshopper definition Origanimator.gh (Grasshopper 1.0.7)
# plug-ins: Anemone, Weaverbird, Human

d_offset = Panel("0.1")

D = Slider(0.5, range=-1..1)
top_line = Curve()
vertical_line = Curve(<curve referenced from the Rhino model>)

# ----
# Horizontal Lines の角度を評価（90度以上or未満）
explode = Explode(Curve=top_line, Recursive=True)  # -> Segments, flatten(Vertices)
shift = ShiftList(List=explode.Vertices, Shift=1, Wrap=True)  # -> flatten(List)
panel = Panel(explode.Vertices)
panel_2 = Panel(shift)
vec2pt = Vector2Pt(PointA=panel, PointB=panel_2, Unitize=False)  # -> flatten(Vector), Length
lng = ListLength(List=vec2pt.Vector)
subtraction = Subtraction(A=lng, B="2")
subset = SubList(List=vec2pt.Vector, Domain=subtraction, Wrap=True)  # -> List, Index
shift_2 = ShiftList(List=subset.List, Shift=1, Wrap=True)
panel_3 = Panel(subset.List)
panel_4 = Panel(shift_2)
xprod = CrossProduct(VectorA=panel_3, VectorB=panel_4, Unitize=False)  # -> Vector, Length
unit = UnitVector(Vector=xprod.Vector)
devec = DeconstructVector(Vector=unit)  # -> XComponent, YComponent, ZComponent
panel_5 = Panel(devec.ZComponent)

# ----
# 平行移動の縦方向の＋ー
explode_2 = Explode(Curve=vertical_line, Recursive=True)  # -> Segments, flatten(Vertices)
shift_3 = ShiftList(List=explode_2.Vertices, Shift=1, Wrap=True)  # -> flatten(List)
panel_6 = Panel(explode_2.Vertices)
panel_7 = Panel(shift_3)
pdecon = Deconstruct(Point=panel_7)  # -> XComponent, YComponent, ZComponent
pdecon_2 = Deconstruct(Point=panel_6)  # -> XComponent, YComponent, ZComponent
larger = LargerThan(FirstNumber=pdecon.XComponent, SecondNumber=pdecon_2.XComponent)  # -> LargerThan, OrEqualTo
lng_2 = ListLength(List=larger.LargerThan)
subtraction_2 = Subtraction(A=lng_2, B="2")
subset_2 = SubList(List=larger.LargerThan, Domain=subtraction_2, Wrap=True)  # -> List, Index
panel_8 = Panel(subset_2.List)
num = Number(panel_8)
panel_9 = Panel(num)
expression = Expression(x=panel_9, Expression="2*x-1")
panel_10 = Panel(expression)

# ----
# Horizontal Lines の角度の絶対値を計算
cluster = Cluster_3(top_lines=top_line, danmen=vertical_line)  # -> mesh, simplify(flatten(vertical_lines)), horizontal_lines, n_of_horizontal_layers, n_of_vertical_layers, initial_d
explode_3 = Explode(Curve=vertical_line, Recursive=True)  # -> Segments, Vertices
explode_4 = Explode(Curve=cluster.horizontal_lines, Recursive=True)  # -> Segments, flatten(Vertices)
data = Data(cluster.mesh)
len = Length(Curve=explode_4.Segments)
len_2 = Length(Curve=explode_3.Segments)
panel_11 = Panel(len)
addition = Addition(A=cluster.n_of_horizontal_layers, B="1")
partition = PartitionList(List=cluster.vertical_lines, Size=addition)  # -> simplify(Chunks)
len_3 = Length(Curve=partition)
branch = TreeBranch(Tree=len_3, Path="{0}", MaintainPaths=True)
item = ListItem(List=len_2, Index="0", Wrap=True)
panel_12 = Panel(branch)

# ----
# Dを計算
panel_13 = Panel("1")
item_2 = ListItem(List=len_3, Index=panel_13, Wrap=True)
panel_14 = Panel(len_2)
item_3 = ListItem(List=flatten(len_2), Index="0", Wrap=True)
item_4 = ListItem(List=flatten(item_2), Index="0", Wrap=True)
division = Division(A=graft(len_2), B=item_2)  # -> flatten(Result)
sort = SortList(Keys=division, ValuesA=division)  # -> Keys, ValuesA
panel_15 = Panel(sort.ValuesA)
num_2 = Number(panel_15)
item_5 = ListItem(List=num_2, Index="0", Wrap=True)
expression_2 = Expression(a=item_3, b=item_4, c=item_5, Expression="(((b²-a²)*(c²))/(1-c²))^(1/2)")
panel_16 = Panel(expression_2)
subtraction_3 = Subtraction(A=panel_16, B=d_offset)
multiplication = Multiplication(A=subtraction_3, B=D)

expression_3 = Expression(a=item, b=branch, d=multiplication, Expression="d/((b²-a²+d²)^(1/2))")
panel_17 = Panel(expression_3)
asin = ArcSine(Value=panel_17)
panel_18 = Panel(asin)

multiplication_2 = Multiplication(A=panel_5, B=panel_18)

# ----
# d/sin(a) (二等分線方向の並行移動の大きさ）
# H（Z軸の方向の並行移動の大きさ）
panel_19 = Panel("1")
item_6 = ListItem(List=partition, Index=panel_19, Wrap=True)  # -> flatten(Item)
item_7 = ListItem(List=multiplication_2, Index=panel_19, Wrap=True)
len_4 = Length(Curve=item_6)
data_2 = Data(len_2)
expression_4 = Expression(a=data_2, b=len_4, c=item_7, Expression="((b²-a²)/(1-sin(c)²))^(1/2)")
panel_20 = Panel(len_4)
multiplication_3 = Multiplication(A=panel_10, B=expression_4)
expression_5 = Expression(b=len_4, c=multiplication_3, Expression="(b²-c²)^(1/2)")
panel_21 = Panel(multiplication_3)
panel_22 = Panel(expression_5)

Y = UnitY(Factor=1)
subtraction_4 = Subtraction(A=cluster.n_of_horizontal_layers, B="1")
multiplication_4 = Multiplication(A=multiplication_2, B="2")
data_3 = Data(Y)
subtraction_5 = Subtraction(A="pi", B=multiplication_4)
fastloopstart = FastLoopStart(Iterations=subtraction_4, Data=data_3)  # -> port, Counter, Data
item_8 = ListItem(List=len, Index=fastloopstart.Counter, Wrap=True)
item_9 = ListItem(List=subtraction_5, Index=fastloopstart.Counter, Wrap=True)
item_10 = ListItem(List=fastloopstart.Data, Index="1", Wrap=True)
item_11 = ListItem(List=fastloopstart.Data, Index="0", Wrap=True)
panel_23 = Panel(subtraction_5)
Z = UnitZ(Factor=1)
vrot = Rotate(Vector=item_11, Axis=Z, Angle=item_9)
panel_24 = Panel(item_8)
lng_3 = ListLength(List=item_8)
amp = Amplitude(Vector=vrot, Amplitude=item_8)
repeat = RepeatData(Data=vrot, Length=lng_3)  # -> simplify(graft(Data))
addition_2 = Addition(A=item_10, B=amp)  # -> simplify(graft(Result))
data_4 = Data([repeat, addition_2])
panel_25 = Panel(amp)
fastloopend = FastLoopEnd(port=fastloopstart.port, Exit=False, Data=data_4, RecordData=True, TimeOutVal=0)
panel_26 = Panel(data_4)
pt = Point(fastloopend)

panel_27 = Panel(pt)
path_mapper = PathMapper(panel_27, source="{A;B}(1)", target="{B}(A)")
pt_2 = ConstructPoint(XCoordinate=0, YCoordinate=0, ZCoordinate=0)
# Horizontal linesのベクトル（点）を生成
tstat = TreeStatistics(Tree=path_mapper)  # -> Paths, Length, Count
pt_3 = Point(pt_2)
repeat_2 = RepeatData(Data=pt_3, Length=tstat.Count)  # -> simplify(graft(Data))
panel_28 = Panel([repeat_2, path_mapper])

# ----
# 二等分線のベクトル生成
panel_29 = Panel("{0}")
branch_2 = TreeBranch(Tree=panel_28, Path=panel_29, MaintainPaths=True)
item_12 = ListItem(List=branch_2, Index="1", Wrap=True)
item_13 = ListItem(List=branch_2, Index="2", Wrap=True)
item_14 = ListItem(List=branch_2, Index="0", Wrap=True)
panel_30 = Panel(branch_2)
vec2pt_2 = Vector2Pt(PointA=item_12, PointB=item_13, Unitize=False)  # -> Vector, Length
vec2pt_3 = Vector2Pt(PointA=item_12, PointB=item_14, Unitize=False)  # -> Vector, Length
unit_2 = UnitVector(Vector=vec2pt_3.Vector)
unit_3 = UnitVector(Vector=vec2pt_2.Vector)
addition_3 = Addition(A=unit_2, B=unit_3)
unit_4 = UnitVector(Vector=addition_3)
panel_31 = Panel(unit_4)

# ----
# Horizontal Lines を生成
panel_32 = Panel("1")
item_15 = ListItem(List=panel_28, Index="0", Wrap=True)
item_16 = ListItem(List=panel_28, Index=panel_32, Wrap=True)
vec2pt_4 = Vector2Pt(PointA=item_16, PointB=item_15, Unitize=False)  # -> Vector, Length
panel_33 = Panel(item_15)
pline = PolyLine(Vertices=panel_28, Closed=False)
panel_34 = Panel(item_16)
move = Move(Geometry=pline, Motion=vec2pt_4.Vector)  # -> Geometry, Transform
panel_35 = Panel(vec2pt_4.Vector)

# ----
# 一番上のラインだけをを取り除く
flatten = FlattenTree(Tree=move.Geometry, Path="{0}")
lng_4 = ListLength(List=flatten)
subtraction_6 = Subtraction(A=lng_4, B="1")
dom = ConstructDomain(DomainStart="1", DomainEnd=subtraction_6)
subset_3 = SubList(List=flatten(flatten), Domain=dom, Wrap=True)  # -> simplify(graft(List)), Index

# ----
# Horizontal Linesの平行移動ベクトルを計算
panel_36 = Panel("1")
vec = VectorXYZ(XComponent="0", YComponent="0", ZComponent="0")  # -> Vector, Length
subtraction_7 = Subtraction(A=cluster.n_of_vertical_layers, B=panel_36)
fastloopstart_2 = FastLoopStart(Iterations=subtraction_7, Data=vec.Vector)  # -> port, Counter, Data

item_17 = ListItem(List=flatten(multiplication_3), Index=fastloopstart_2.Counter, Wrap=True)  # -> flatten(Item)
item_18 = ListItem(List=flatten(expression_5), Index=fastloopstart_2.Counter, Wrap=True)  # -> flatten(Item)
Z_2 = UnitZ(Factor="-1")
multiplication_5 = Multiplication(A=unit_4, B=item_17)
multiplication_6 = Multiplication(A=Z_2, B=item_18)
addition_4 = Addition(A=multiplication_5, B=multiplication_6)
addition_5 = Addition(A=fastloopstart_2.Data, B=addition_4)

fastloopend_2 = FastLoopEnd(port=fastloopstart_2.port, Exit=False, Data=addition_5, RecordData=True, TimeOutVal=0)  # -> simplify(Data)

# ----
# Horizontal Linesを並行移動。（Horizontal lines 完成）
item_19 = ListItem(List=flatten(move.Geometry), Index=0, Wrap=True)

move_2 = Move(Geometry=subset_3.List, Motion=fastloopend_2)  # -> flatten(Geometry), Transform
panel_37 = Panel(move_2.Geometry)

merge = Merge(Data1=item_19, Data2=move_2.Geometry)

panel_38 = Panel(merge)

origamifromhorizontallines = OrigamiFromHorizontalLines_2(data=merge, nofh=cluster.n_of_horizontal_layers, A=cluster.n_of_vertical_layers)  # -> R, L
wbthicken = WeaverbirdsMeshThicken(MeshCurves=origamifromhorizontallines.R, Distance="1", OffsetType=0)
mattable = MaterialTable(Update="true")  # -> MaterialName, Shader, Diffuse, Specular, Emission, Alpha, Gloss
panel_39 = Panel(mattable.MaterialName)
preview = CustomPreview(Geometry=wbthicken, Material=mattable.MaterialName)

# ==== cluster Cluster_3
danmen = ClusterInput()
top_lines = ClusterInput()
top_lines_2 = Curve(top_lines)
danmen_2 = Curve(danmen)
explode = Explode(Curve=danmen_2, Recursive=True)  # -> Segments, Vertices
explode_2 = Explode(Curve=top_lines_2, Recursive=True)  # -> Segments, Vertices

# ----
# 縦インプットをベクトルに変換
panel = Panel("0")
subset = SubList(List=explode.Vertices, Domain=panel, Wrap=True)  # -> List, Index
vec2pt = Vector2Pt(PointA=subset.List, PointB=explode.Vertices, Unitize=False)  # -> Vector, Length
lng = ListLength(List=vec2pt.Vector)
subtraction = Subtraction(A=lng, B="1")
dom = ConstructDomain(DomainStart="1", DomainEnd=subtraction)
subset_2 = SubList(List=vec2pt.Vector, Domain=dom, Wrap=True)  # -> List, Index

lng_2 = ListLength(List=explode_2.Segments)
lng_3 = ListLength(List=explode.Segments)
n_of_vertical_layers = ClusterOutput(lng_3)
n_of_horizontal_layers = ClusterOutput(lng_2)

# ----
# オフセット＋平行移動
devec = DeconstructVector(Vector=subset_2.List)  # -> XComponent, YComponent, ZComponent
offset = OffsetCurve(Curve=top_lines_2, Distance=devec.XComponent, Plane=PlaneXY(0, 0, 0), Corners=1)  # -> flatten(Curve)
Z = UnitZ(Factor=devec.YComponent)

polylineoffset = PolylineOffset(
    Polyline=top_lines_2,
    Distance=graft(devec.XComponent),
    AbsoluteTolerance=0,
    AngleTolerance=0,
    KeepDuplicates=False,
    AvoidSelfIntersections=False)  # -> flatten(OffsettedPolyline), OffsettedPolylineReverse

move = Move(Geometry=polylineoffset.OffsettedPolyline, Motion=Z)  # -> flatten(Geometry), Transform

merge = Merge(Data1=top_lines_2, Data2=move.Geometry)
# Horizontal lines からメッシュ生成
origamifromhorizontallines = OrigamiFromHorizontalLines(data=merge, A=lng_3, nofh=lng_2)  # -> R, L
item = ListItem(List=devec.XComponent, Index="0", Wrap=True)
initial_d = ClusterOutput(item)
vertical_lines = ClusterOutput(origamifromhorizontallines.L)
horizontal_lines = ClusterOutput(merge)
mesh = ClusterOutput(origamifromhorizontallines.R)

# ==== cluster OrigamiFromHorizontalLines_2
nofh = ClusterInput()
A = ClusterInput()
data = ClusterInput()

data_2 = Data(data)
addition = Addition(A=nofh, B="1")
multiplication = Multiplication(A=A, B=addition)
subtraction = Subtraction(A=multiplication, B="1")
dom = ConstructDomain(DomainStart="0", DomainEnd=subtraction)
panel = Panel(dom)
explode = Explode(Curve=data_2, Recursive=True)  # -> Segments, flatten(Vertices)
panel_2 = Panel(addition)
shift = ShiftList(List=explode.Vertices, Shift=panel_2, Wrap=True)
ln = Line(StartPoint=explode.Vertices, EndPoint=shift)
subset = SubList(List=ln, Domain=panel, Wrap=True)  # -> List, Index
merge = Merge(Data1=explode.Segments, Data2=subset.List)  # -> flatten(Result)
wbweave = WeaverbirdsMeshFromLinesWeaveBack(Lines=merge, MaximumValence=4)  # disabled

cluster = Cluster_4(L=simplify(explode.Segments), relay=subset.List, A=nofh)
L = ClusterOutput(subset.List)
R = ClusterOutput(cluster)

# ==== cluster OrigamiFromHorizontalLines
A = ClusterInput()
nofh = ClusterInput()
data = ClusterInput()

data_2 = Data(data)
addition = Addition(A=nofh, B="1")
multiplication = Multiplication(A=A, B=addition)
subtraction = Subtraction(A=multiplication, B="1")
dom = ConstructDomain(DomainStart="0", DomainEnd=subtraction)
panel = Panel(addition)
panel_2 = Panel(dom)
explode = Explode(Curve=data_2, Recursive=True)  # -> Segments, flatten(Vertices)
shift = ShiftList(List=explode.Vertices, Shift=panel, Wrap=True)
ln = Line(StartPoint=explode.Vertices, EndPoint=shift)
subset = SubList(List=ln, Domain=panel_2, Wrap=True)  # -> List, Index
merge = Merge(Data1=explode.Segments, Data2=subset.List)  # -> flatten(Result)
wbweave = WeaverbirdsMeshFromLinesWeaveBack(Lines=merge, MaximumValence=4)  # disabled

cluster = Cluster_2(L=simplify(explode.Segments), relay=subset.List, A=nofh)
L = ClusterOutput(subset.List)
R = ClusterOutput(cluster)

# ==== cluster Cluster_4
L = ClusterInput()
relay = ClusterInput()
A = ClusterInput()
shift = ShiftList(List=flatten(L), Shift=A, Wrap=True)  # -> flatten(List)
addition = Addition(A=A, B="1")
lng = ListLength(List=shift)
subtraction = Subtraction(A=lng, B=A)
partition = PartitionList(List=relay, Size=addition)  # -> simplify(Chunks)
shift_2 = ShiftList(List=partition, Shift=1, Wrap=True)  # -> simplify(List)
subtraction_2 = Subtraction(A=subtraction, B="1")
subset = SubList(List=flatten(shift), Domain=subtraction_2, Wrap=True)  # -> List, Index
subset_2 = SubList(List=flatten(L), Domain=subtraction_2, Wrap=True)  # -> List, Index
cluster = Cluster(L=partition)  # -> simplify(graft(L_2))
cluster_2 = Cluster(L=shift_2)  # -> simplify(graft(L_2))
merge = Merge(Data1=cluster, Data2=cluster_2)
data = Data(subset_2.List)
partition_2 = PartitionList(List=subset_2.List, Size=A)  # -> simplify(graft(Chunks))
partition_3 = PartitionList(List=subset.List, Size=A)  # -> simplify(graft(Chunks))
merge_2 = Merge(Data1=partition_3, Data2=partition_2)
merge_3 = Merge(Data1=merge_2, Data2=merge)
item = ListItem(List=merge_3, Index=0, Wrap=True)
item_2 = ListItem(List=merge_3, Index="2", Wrap=True)
item_3 = ListItem(List=merge_3, Index="1", Wrap=True)
item_4 = ListItem(List=merge_3, Index="3", Wrap=True)
edgesrf = EdgeSurface(CurveA=item, CurveB=item_3, CurveC=item_2, CurveD=item_4)
mesh = MeshBrep(
    Brep=edgesrf,
    Settings={GridMaxCount=0, GridMinCount=16, JaggedSeams=False, MaxEdgeLength=0, MinEdgeLength=0.0001, MinTolerance=0, Refine=True, RefineAngle=0, RelativeTolerance=0.65, SimplePlanes=True, Tolerance=0})
M = ClusterOutput(mesh)

# ==== cluster Cluster_2
L = ClusterInput()
relay = ClusterInput()
A = ClusterInput()
shift = ShiftList(List=flatten(L), Shift=A, Wrap=True)  # -> flatten(List)
addition = Addition(A=A, B="1")
lng = ListLength(List=shift)
subtraction = Subtraction(A=lng, B=A)
partition = PartitionList(List=relay, Size=addition)  # -> simplify(Chunks)
shift_2 = ShiftList(List=partition, Shift=1, Wrap=True)  # -> simplify(List)
subtraction_2 = Subtraction(A=subtraction, B="1")
subset = SubList(List=flatten(shift), Domain=subtraction_2, Wrap=True)  # -> List, Index
subset_2 = SubList(List=flatten(L), Domain=subtraction_2, Wrap=True)  # -> List, Index
cluster = Cluster(L=partition)  # -> simplify(graft(L_2))
cluster_2 = Cluster(L=shift_2)  # -> simplify(graft(L_2))
merge = Merge(Data1=cluster, Data2=cluster_2)
data = Data(subset_2.List)
partition_2 = PartitionList(List=subset.List, Size=A)  # -> simplify(graft(Chunks))
partition_3 = PartitionList(List=subset_2.List, Size=A)  # -> simplify(graft(Chunks))
merge_2 = Merge(Data1=partition_2, Data2=partition_3)
merge_3 = Merge(Data1=merge_2, Data2=merge)
item = ListItem(List=merge_3, Index=0, Wrap=True)
item_2 = ListItem(List=merge_3, Index="2", Wrap=True)
item_3 = ListItem(List=merge_3, Index="1", Wrap=True)
item_4 = ListItem(List=merge_3, Index="3", Wrap=True)
edgesrf = EdgeSurface(CurveA=item, CurveB=item_3, CurveC=item_2, CurveD=item_4)
mesh = MeshBrep(
    Brep=edgesrf,
    Settings={GridMaxCount=0, GridMinCount=16, JaggedSeams=False, MaxEdgeLength=0, MinEdgeLength=0.0001, MinTolerance=0, Refine=True, RefineAngle=0, RelativeTolerance=0.65, SimplePlanes=True, Tolerance=0})
M = ClusterOutput(mesh)

# ==== cluster Cluster
L = ClusterInput()
lng = ListLength(List=L)
subtraction = Subtraction(A=lng, B="2")
subset = SubList(List=L, Domain=subtraction, Wrap=True)  # -> List, Index
L_2 = ClusterOutput(subset.List)
